# Grasshopper definition 3rob_cell_visualize.ghx (Grasshopper 1.0.7)

# ----
# ROBOT CONNECT
panel = Panel("ros-79hh-s4fg.yaler.io")
ros = ROSConnect(connect=Toggle(True))  # -> ros_client, is_connected; inputs port: Int32, connect: Boolean
#   port ip: The ip address ROS. Defaults to 127.0.0.1.
#   port port: The port of ROS. Defaults to 9090.
#   port connect: If True, connects to ROS. If False, disconnects from ROS. Defaults to False.
#   port ros_client: The ROS client.
#   port is_connected: True if connection established.
# ---------- ros: Python ----------
"""
Connect or disconnect to ROS.

COMPAS FAB v0.19.1
"""
from ghpythonlib.componentbase import executingcomponent as component
from scriptcontext import sticky as st

from compas_fab.backends import RosClient
from compas_fab.ghpython.components import create_id


class ROSConnect(component):
    def RunScript(self, ip, port, connect):
        ros_client = None

        ip = ip or '127.0.0.1'
        port = port or 9090

        key = create_id(self, 'ros_client')
        ros_client = st.get(key, None)

        if ros_client:
            st[key].close()
        if connect:
            st[key] = RosClient(ip, port)
            st[key].run(5)

        ros_client = st.get(key, None)
        is_connected = ros_client.is_connected if ros_client else False
        return (ros_client, is_connected)
# ---------- end ros ----------
data = Data(ros.ros_client)
robot = ROSRobot(ros_client=data, load=Toggle(True))  # -> robot; inputs load: Boolean
#   port ros_client: The ROS client.
#   port load: If True, loads the robot from ROS. Defaults to False.
# ---------- robot: Python ----------
"""
Load robot directly from ROS.

COMPAS FAB v0.19.1
"""
from compas_ghpython.artists import RobotModelArtist
from ghpythonlib.componentbase import executingcomponent as component
from scriptcontext import sticky as st

from compas_fab.ghpython.components import create_id


class ROSRobot(component):
    def RunScript(self, ros_client, load):
        key = create_id(self, 'robot')

        if ros_client and ros_client.is_connected and load:
            # Load URDF from ROS
            st[key] = ros_client.load_robot(load_geometry=True, precision='12f')
            st[key].artist = RobotModelArtist(st[key].model)

        robot = st.get(key, None)
        if robot:  # client sometimes need to be restarted, without needing to reload geometry
            robot.client = ros_client
        return robot
# ---------- end robot ----------
data_2 = Data(robot)

# ----
# ECL PLATFORM MESH
mesh = Mesh([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])

# ----
# Planning Preset
python = GhPythonScript()  # -> config
# ---------- python: Python ----------
#axis 1-6
config = [
40.55,
16.21,
-13.89,
-0.0,
87.68,
130.55]
# ---------- end python ----------
# PRESET CONFIGS
python_2 = GhPythonScript()  # -> config
# ---------- python_2: Python ----------
#ROBOT 1 CONFIG
#Start path planning from

#axis 1-6 + track (mm)
config = [
-37.57,
-3.24,
8.36,
0.19,
84.45,
230,
100]

#config = [
#-37.57,
#-3.24,
#8.36,
#0.19,
#84.45,
#230,
#100]
# ---------- end python_2 ----------
python_3 = GhPythonScript()  # -> config
# ---------- python_3: Python ----------
#ROBOT 1 CONFIG
#Start path planning from

#axis 1-6 + track
config = [
40.55,
16.21,
-13.89,
-0.0,
87.68,
130.55,
3900]

#axis 1-6 + track
#config = [40.55,16.21,-13.89,-0.0,87.68,130.55,3900]
# ---------- end python_3 ----------
config = GhPythonScript(robot=data_2, r1=python_2, r2=python_3, r3=python)  # -> config, config_scaled; inputs r1: list, r2: list, r3: list
# ---------- config: Python ----------
import math

config = robot.zero_configuration()

for i in range(6):
    config['r1_joint_{}'.format(i + 1)] = r1[i]
    config['r2_joint_{}'.format(i + 1)] = r2[i]
    config['r3_joint_{}'.format(i + 1)] = r3[i]

#mm
config['r1_cart_joint'] = r1[6]
config['r2_cart_joint'] = r2[6]

print config

#for use in path planning
#radians and meters
config_scaled = robot.zero_configuration()

for i in range(6):
    config_scaled['r1_joint_{}'.format(i + 1)] = math.radians(r1[i])
    config_scaled['r2_joint_{}'.format(i + 1)] = math.radians(r2[i])
    config_scaled['r3_joint_{}'.format(i + 1)] = math.radians(r3[i])

#mm --> m
config_scaled['r1_cart_joint'] = r1[6]/1000
config_scaled['r2_cart_joint'] = r2[6]/1000

print config_scaled
# ---------- end config ----------

# ----
# Return Preset
python_4 = GhPythonScript()  # -> config
# ---------- python_4: Python ----------
#RETURN CONFIG (BEFORE PICKUP)

#axis 1-6 + track (mm)
config = [
-90.0,
0.0,
0.0,
0.0,
90,
180,
100]
# ---------- end python_4 ----------
python_5 = GhPythonScript()  # -> config
# ---------- python_5: Python ----------
#RETURN CONFIG (BEFORE PICKUP)

#axis 1-6 + track
config = [
90.0,
0.0,
0.0,
0.0,
90,
180,
3900]
# ---------- end python_5 ----------
python_6 = GhPythonScript()  # -> config
# ---------- python_6: Python ----------
#axis 1-6
config = [
90.0,
0.0,
0.0,
0.0,
90,
180]
# ---------- end python_6 ----------
config_2 = GhPythonScript(robot=data_2, r1=python_4, r2=python_5, r3=python_6)  # -> config, config_scaled; inputs r1: list, r2: list, r3: list; same code as config

# ----
# Robot 3
j4 = Slider(0, range=-400..400)
j6 = Slider(0, range=-400..400)
j1 = Slider(0, range=-180..180)
j2 = Slider(-90, range=-90..150)
j3 = Slider(75, range=-180..75)
j5 = Slider(0, range=-125..120)
data_3 = Data([j1, j2, j3, j4, j5, j6])

# ----
# Robot 2
j1_2 = Slider(0, range=-180..180)
j2_2 = Slider(0, range=-90..150)
j3_2 = Slider(0, range=-180..75)
j4_2 = Slider(0, range=-400..400)
j5_2 = Slider(0, range=-125..120)
j6_2 = Slider(0, range=-400..400)
track = Slider(1.15, range=0..4)
data_4 = Data([j1_2, j2_2, j3_2, j4_2, j5_2, j6_2, track])

# ----
# Robot 1
j1_3 = Slider(0, range=-180..180)
j2_3 = Slider(0, range=-90..150)
j3_3 = Slider(-9.02, range=-180..75)
j4_3 = Slider(-21.24, range=-400..400)
j5_3 = Slider(7.59, range=-125..120)
j6_3 = Slider(92.01, range=-400..400)
track_2 = Slider(1.82, range=0..4)
data_5 = Data([j1_3, j2_3, j3_3, j4_3, j5_3, j6_3, track_2])

# ----
# If axis is included then allow the robot to move along track
list = ValueList({"Robot 1": 1, "Robot 2": 2, "Robot 3": 3}, selected="Robot 1")
rob_num = Number(list)
list_2 = ValueList({"Robot 1 - No Track, No Gripper": "robot1_notrack", "Robot 1 - No Track, Gripper": "robot1_notrack_gripper", "Robot 1 - Track, No Gripper": "robot1_track", "Robot 1 - Track, Gripper": "robot1_track_gripper"}, selected="Robot 1 - Track, Gripper")
list_3 = ValueList({"Robot 2 - No Track, No Gripper": "robot2_notrack", "Robot 2 - No Track, Gripper": "robot2_notrack_gripper", "Robot 2 - Track, No Gripper": "robot2_track", "Robot 2 - Track, Gripper": "robot2_track_gripper"}, selected="Robot 2 - No Track, No Gripper")
list_4 = ValueList({"Robot 3 - No Gripper": "robot3", "Robot 3 - Gripper": "robot3_gripper"}, selected="Robot 3 - Gripper")
list_5 = ValueList({"platform": "ecl_platform", "world": "ecl_zero", "wobj_1": "rob1_acadia_EBIT_01", "wobj_2": "rob2_acadia_EBIT_01"}, selected="wobj_1")
list_6 = ValueList({"platform": "ecl_platform", "world": "ecl_zero", "wobj_1": "rob1_acadia_EBIT_01", "wobj_2": "rob2_acadia_EBIT_01"}, selected="wobj_2")
list_7 = ValueList({"platform": "ecl_platform", "world": "ecl_zero", "wobj_1": "rob1_acadia_EBIT_01", "wobj_2": "rob2_acadia_EBIT_01"}, selected="wobj_2")
data_6 = Data(list_2)
data_7 = Data(list_3)
panel_2 = Panel(rob_num)
panel_3 = Panel(rob_num)
filter = StreamFilter(Gate=panel_3, Stream1=list_5, Stream2=list_6, Stream3=list_7)
data_8 = Data(filter)

data_9 = Data(list_4)

filter_2 = StreamFilter(Gate=panel_2, Stream1=data_6, Stream2=data_7, Stream3=data_9)
data_10 = Data(filter_2)

# ----
# move/rotate plane around on rhino canvas
pt = Point(<point referenced from the Rhino model>)
crv = Curve(<curve referenced from the Rhino model>)
crv_2 = Curve(<curve referenced from the Rhino model>)
crv_3 = Curve(<curve referenced from the Rhino model>)
crv_4 = Curve(<curve referenced from the Rhino model>)
crv_5 = Curve(<curve referenced from the Rhino model>)
crv_6 = Curve(<curve referenced from the Rhino model>)
pt_2 = Point(<point referenced from the Rhino model>)
pt_3 = Point(<point referenced from the Rhino model>)
pl = ConstructPlane(Origin=pt, XAxis=crv, YAxis=crv_6)
pl_2 = ConstructPlane(Origin=pt_2, XAxis=crv_2, YAxis=crv_3)
pl_3 = ConstructPlane(Origin=pt_3, XAxis=crv_4, YAxis=crv_5)
panel_4 = Panel(rob_num)
filter_3 = StreamFilter(Gate=panel_4, Stream1=pl, Stream2=pl_2, Stream3=pl_3)

# ----
# FORWARD KINEMATICS
config_3 = GhPythonScript(robot=data_2, r1=data_5, r2=data_4, r3=data_3)  # -> config; inputs r1: list, r2: list, r3: list
# ---------- config_3: Python ----------
import math

config = robot.zero_configuration()

for i in range(6):
    config['r1_joint_{}'.format(i + 1)] = math.radians(r1[i])
    config['r2_joint_{}'.format(i + 1)] = math.radians(r2[i])
    config['r3_joint_{}'.format(i + 1)] = math.radians(r3[i])

config['r1_cart_joint'] = r1[6]
config['r2_cart_joint'] = r2[6]

print config
# ---------- end config_3 ----------
gripper_frames = GhPythonScript(robot=data_2, group=data_10, config=config_3)  # -> out
# ---------- gripper_frames: Python ----------
print repr(robot.forward_kinematics(config, group=group))
# ---------- end gripper_frames ----------
panel_5 = Panel(gripper_frames)

# ----
# INVERSE KINEMATICS
use_fk_as_start = BooleanToggle(True)
data_11 = Data(config_3)
filter_4 = StreamFilter(Gate=use_fk_as_start, Stream1=data_11)
pln = Plane(filter_3)
data_12 = Data(filter_4)
ik = InverseKinematics(robot=data_2, plane=pln, start_configuration=data_12, group=data_10)  # -> configuration
#   port plane: The plane or frame to calculate the inverse kinematic for.
#   port start_configuration: If passed, calculates the inverse such that the joint positions differ the least from the start_configuration. Defaults to the zero configuration.
#   port group: The planning group used for calculation. Defaults to the robot's main planning group.
#   port configuration: The planning group's configuration.
# ---------- ik: Python ----------
"""
Calculate the robot's inverse kinematic for a given plane.

COMPAS FAB v0.19.1
"""
from ghpythonlib.componentbase import executingcomponent as component

from compas_fab.ghpython.components import coerce_frame


class InverseKinematics(component):
    def RunScript(self, robot, plane, start_configuration, group):
        configuration = None
        if robot and robot.client and robot.client.is_connected and plane:
            frame = coerce_frame(plane)
            configuration = robot.inverse_kinematics(frame, start_configuration, group)
        if start_configuration:
            return start_configuration.merged(configuration)
        else:
            return configuration
# ---------- end ik ----------

list_8 = ValueList({"Forward Kinematics": 0, "Inverse Kinematics": 1, "Preset Start Planning Config": 2, "Preset Return Config": 3}, selected="Inverse Kinematics")
filter_5 = StreamFilter(Gate=list_8, Stream0=config_3, Stream1=ik, Stream2=config.config_scaled, Stream3=config_2.config_scaled)
robot_visualize = RobotVisualize(robot=data_2, group=data_10, configuration=filter_5)  # -> visual, collision, attached_meshes, frames, base_frame, ee_frame; inputs attached_collision_meshes: list, show_visual: Boolean, show_collision: Boolean, show_frames: Boolean, show_base_frame: Boolean, show_end_effector_frame: Boolean, show_acm: Boolean
#   port group: The planning group used for end-effector and base visualization.
#   port configuration: The robot's full configuration.
#   port attached_collision_meshes: A list of attached collision meshes.
#   port show_visual: Whether or not to show the robot's visual meshes.
#   port show_collision: Whether or not to show the robot's collision meshes.
#   port show_frames: Whether or not to show the robot's joint frames.
#   port show_base_frame: Whether or not to show the robot's base frame.
#   port show_end_effector_frame: Whether or not to show the robot's end-effector frame.
#   port show_acm: Whether or not to show the attached collision meshes (if any).
#   port visual: The robot's visual Rhino meshes (if any).
#   port collision: The robot's collision Rhino meshes (if any).
#   port attached_meshes: The attached collision Rhino meshes (if any).
#   port frames: The robot's joint frames as Rhino planes (if any).
#   port base_frame: The robot's base frame as a Rhino plane (if any).
#   port ee_frame: The robot's end-effector frame as a Rhino plane (if any).
# ---------- robot_visualize: Python ----------
"""
Visualizes the robot.

COMPAS FAB v0.19.1
"""
from compas.geometry import Frame
from compas.geometry import Transformation
from compas_ghpython.artists import FrameArtist
from compas_ghpython.artists import MeshArtist
from ghpythonlib.componentbase import executingcomponent as component


class RobotVisualize(component):
    def RunScript(self, robot, group, configuration, attached_collision_meshes, show_visual, show_collision,
                  show_frames, show_base_frame, show_end_effector_frame, show_acm):

        visual = None
        collision = None
        attached_meshes = None
        frames = None
        base_frame = None
        ee_frame = None

        if robot:
            show_visual = True if show_visual is None else show_visual
            configuration = configuration or robot.zero_configuration()

            robot.update(configuration, visual=show_visual, collision=show_collision)
            compas_frames = robot.transformed_frames(configuration, group)

            if show_visual:
                visual = robot.artist.draw_visual()

            if show_collision:
                collision = robot.artist.draw_collision()

            if show_base_frame:
                base_compas_frame = compas_frames[0]
                artist = FrameArtist(base_compas_frame)
                base_frame = artist.draw()

            if show_end_effector_frame:
                ee_compas_frame = robot.forward_kinematics(configuration, group, options=dict(solver='model'))
                artist = FrameArtist(ee_compas_frame)
                ee_frame = artist.draw()

            if show_frames:
                frames = []
                for compas_frame in compas_frames[1:]:
                    artist = FrameArtist(compas_frame)
                    frame = artist.draw()
                    frames.append(frame)

            if show_acm:
                attached_meshes = []
                for acm in attached_collision_meshes:
                    frame = robot.forward_kinematics(configuration, options=dict(solver='model', link_name=acm.link_name))
                    T = Transformation.from_frame_to_frame(Frame.worldXY(), frame)
                    mesh = acm.collision_mesh.mesh.transformed(T)
                    attached_meshes.append(MeshArtist(mesh).draw())

        return (visual, collision, attached_meshes, frames, base_frame, ee_frame)
# ---------- end robot_visualize ----------
